# Dynamo custom node CurtianPanelPts.dyf (Dynamo 1.0.0.1180)
# category: CM.Core
# Gets vertices of curtian panel

all_elements_of_family_type = ElementsOfFamilyType()
elements = Input()
boundaries = CurtainPanel.Boundaries(elements)
curves = PolyCurve.Curves(boundaries)
endPoint = Curve.EndPoint(curves)
code_block = CodeBlock { 1; }
flatten = List.Flatten(list=endPoint, amt=code_block)
pts = Output(flatten)
